% Simulink data dictionary battery_status.sldd

packVoltage_V = Simulink.Parameter(350, DataType="single", Unit="V")  % xz
hvBatteryCharge_Ah = Simulink.Parameter([], DataType="single")
nominalCapacity_kWh = Simulink.Parameter(4, DataType="single", Unit="kW/h")  % xz
AmbTemp = Simulink.Parameter(293.15, DataType="single", Unit="K")  % Kelvin krytoi
internal_R_Ohm = Simulink.Parameter(0.01, DataType="single", Unit=" Ohm")  % xz
hvBatterySOC_pct = Simulink.Parameter(70, DataType="single", Unit="%")  % to do signal!
A = Simulink.Signal(DataType="Bus: Bus", Unit="A")  % BatteryCurrentA
V = Simulink.Signal(DataType="single", Unit="V")  % BatteryV
PowerLoss = Simulink.Signal(DataType="single", Unit="W")  % BatteryLoss
Charge = Simulink.Signal(DataType="single", Unit="A*hr")  % BatteryCharge
Power = Simulink.Signal(DataType="single", Unit="W")  % BatteryPower

Bus = Simulink.Bus()
  A: single, Unit="A"  % ButteryCurrent
  V: single, Unit="V"  % BatteryV
  Charge: single, Unit="A*hr"  % BatteryCharge
  Power: single, Unit="W"  % BatteryPower
  BatteryLoss: single, Unit="W"  % BatteryLoss