% Simulink data dictionary speed_controller.sldd
% references common.sldd

Ki = Simulink.Parameter(60, DataType="single")  % Integral Coefficient
trqMax_Nm = Simulink.Parameter(360, DataType="single", Min=300, Max=400, Unit="N*m")  % Max Torque
FiltFreq = Simulink.Parameter(20, DataType="single", Unit="Hz")  % LowPassFrequencyFilter
Kp = Simulink.Parameter(60, DataType="single")  % Proportional Coefficient